# Grasshopper definition lampshade_360_slicer.gh (Grasshopper 1.0.8)

base_width = Slider(24, range=0..200)
amount_of_sides = Slider(5, range=0..10)
top_width = Slider(70, range=0..200)
height = Slider(255, range=0..500)
center_width = Slider(75, range=0..200)
shape_spacing = Slider(25, range=0..200)

# ----
# mapping slices to xy plane
number_slider = Slider(3019, range=0..4000)
construct_domain = ConstructDomain(DomainStart=Slider(215, range=0..300), DomainEnd=number_slider)
range = Range(Domain=construct_domain, Steps=Slider(10, range=0..20))
xy_plane = XYPlane(Origin=Point(0, 0, 0))
unit_x = UnitX(Factor=range)
move = Move(Geometry=xy_plane, Motion=unit_x)  # -> Geometry, Transform

circle = Circle(Plane=PlaneXY(0, 0, 0), Radius=base_width)
circle_2 = Circle(Plane=PlaneXY(0, 0, 0), Radius=Slider(58, range=0..100))
circle_3 = Circle(Plane=PlaneXY(0, 0, 0), Radius=Slider(55, range=0..100))

# ----
# setting up the base shape
vector_xyz = VectorXYZ(XComponent=0, YComponent=0, ZComponent=height)  # -> Vector, Length
vector_xyz_2 = VectorXYZ(XComponent=0, YComponent=0, ZComponent=shape_spacing)  # -> Vector, Length
polygon = Polygon(Plane=PlaneXY(0, 0, 0), Radius=top_width, Segments=amount_of_sides, FilletRadius=0)  # -> Polygon, Length
polygon_2 = Polygon(Plane=PlaneXY(0, 0, 0), Radius=center_width, Segments=amount_of_sides, FilletRadius=0)  # -> Polygon, Length
polygon_3 = Polygon(Plane=PlaneXY(0, 0, 0), Radius=base_width, Segments=amount_of_sides, FilletRadius=0)  # -> Polygon, Length
move_2 = Move(Geometry=circle, Motion=vector_xyz.Vector)  # -> Geometry, Transform
move_3 = Move(Geometry=circle_2, Motion=vector_xyz_2.Vector)  # -> Geometry, Transform
loft = Loft(
    Curves=[circle_3, move_3.Geometry, move_2.Geometry],
    Options={Adjust=False, Closed=False, LoftEnds=0, LoftSimp=0, LoftType=0, Rebuild=10, Refit=0.01})

vector_xyz_3 = VectorXYZ(XComponent=0, YComponent=0, ZComponent=height)  # -> Vector, Length
vector_xyz_4 = VectorXYZ(XComponent=0, YComponent=0, ZComponent=0)  # -> Vector, Length
point = Point(vector_xyz_4.Vector)
point_2 = Point(vector_xyz_3.Vector)
line = Line(StartPoint=point_2, EndPoint=point)
panel = Panel("twist")
twist = Twist(Geometry=loft, Axis=line, Angle=Slider(0, range=0..2.5), Infinite=False, Rigid=False)

number_slider_2 = Slider(0.7, range=0..1)
cap_holes = CapHoles(Brep=twist)
scale_nu = ScaleNU(Geometry=twist, Plane=PlaneXY(0, 0, 0), ScaleX=number_slider_2, ScaleY=number_slider_2, ScaleZ=1)  # -> Geometry, Transform
area = Area(Geometry=move.Geometry)  # -> Area, Centroid
merge = Merge(Data1=cap_holes)
cap_holes_2 = CapHoles(Brep=scale_nu.Geometry)

division = Division(A=Slider(360, range=0..1000), B=Slider(18, range=0..50))
series = Series(Start=0, Step=division, Count=10)
radians = Radians(Degrees=series)
yz_plane = YZPlane(Origin=Point(0, 0, 0))
rotate = Rotate(Geometry=yz_plane, Angle=radians, Plane=PlaneXY(0, 0, 0))  # -> Geometry, Transform
brep_plane = BrepPlane(Brep=merge, Plane=rotate.Geometry)  # -> flatten(Curves), Points

merge_2 = Merge(Data1=cap_holes_2)
multiplication = Multiplication(A=division, B=Slider(-1, range=-1..10))
brep_plane_2 = BrepPlane(Brep=merge_2, Plane=rotate.Geometry)  # -> flatten(Curves), Points
orient = Orient(Geometry=brep_plane_2.Curves, Source=yz_plane, Target=move.Geometry)  # -> Geometry, Transform
series_2 = Series(Start=0, Step=multiplication, Count=10)
orient_2 = Orient(Geometry=brep_plane.Curves, Source=yz_plane, Target=move.Geometry)  # -> Geometry, Transform
radians_2 = Radians(Degrees=series_2)
unit_y = UnitY(Factor=1)
rotate_3d = Rotate3D(Geometry=orient.Geometry, Angle=radians_2, Center=area.Centroid, Axis=unit_y)  # -> Geometry, Transform
rotate_3d_2 = Rotate3D(Geometry=orient_2.Geometry, Angle=radians_2, Center=area.Centroid, Axis=unit_y)  # -> Geometry, Transform
list_length = ListLength(List=rotate_3d_2.Geometry)
number_slider_3 = Slider(7, range=0..50)
explode = Explode(Curve=rotate_3d_2.Geometry, Recursive=True)  # -> Segments, Vertices
series_3 = Series(Start=Slider(1, range=0..1), Step=1, Count=list_length)
list_item = ListItem(List=explode.Segments, Index=0, Wrap=True)  # -> flatten(Item)
list_item_2 = ListItem(List=explode.Segments, Index=Slider(2, range=0..10), Wrap=True)  # -> flatten(Item)
text_tag_3d = TextTag3D(Location=list_item, Text=series_3, Size=number_slider_3, Justification=7)
text_tag_3d_2 = TextTag3D(Location=list_item_2, Text=series_3, Size=number_slider_3, Justification=7)
