# Grasshopper definition lampshade_combined.gh (Grasshopper 1.0.8)

# ----
# setting up the base shape
number_slider = Slider(58, range=0..100)
height = Slider(255, range=0..500)
base_width = Slider(24, range=0..200)
circle = Circle(Plane=PlaneXY(0, 0, 0), Radius=number_slider)
circle_2 = Circle(Plane=PlaneXY(0, 0, 0), Radius=base_width)
vector_xyz = VectorXYZ(XComponent=0, YComponent=0, ZComponent=height)  # -> Vector, Length
move = Move(Geometry=circle_2, Motion=vector_xyz.Vector)  # -> Geometry, Transform
area = Area(Geometry=move.Geometry)  # -> Area, Centroid
area_2 = Area(Geometry=circle)  # -> Area, Centroid
line = Line(StartPoint=area.Centroid, EndPoint=area_2.Centroid)
point_on_curve = PointOnCurve(line, parameter=0.75)
point_on_curve_2 = PointOnCurve(line, parameter=0.5)
point_on_curve_3 = PointOnCurve(line, parameter=0.25)
circle_3 = Circle(Plane=point_on_curve_3, Radius=Slider(24, range=0..200))
circle_4 = Circle(Plane=point_on_curve, Radius=Slider(24, range=0..200))
circle_5 = Circle(Plane=point_on_curve_2, Radius=Slider(75, range=0..200))
loft = Loft(
    Curves=[move.Geometry, circle_3, circle_5, circle_4, circle],
    Options={Adjust=False, Closed=False, LoftEnds=0, LoftSimp=0, LoftType=0, Rebuild=10, Refit=0.01})

bulb_base_length_in_mm = Slider(51, range=0..100)

base_width_top = Slider(23, range=0..100)
base_width_bottom = Slider(25.7, range=0..100)
# Making the bottom shape of the stand
xy = XYPlane(Origin=Point(0, 0, 0))
base_height = Slider(14.4, range=0..100)
cir = Circle(Plane=PlaneXY(0, 0, 0), Radius=base_width_top)
vec = VectorXYZ(XComponent=0, YComponent=0, ZComponent=base_height)  # -> Vector, Length
cir_2 = Circle(Plane=xy, Radius=base_width_bottom)
move_2 = Move(Geometry=cir, Motion=vec.Vector)  # -> Geometry, Transform
loft_2 = Loft(
    Curves=[cir_2, move_2.Geometry],
    Options={Adjust=False, Closed=False, LoftEnds=0, LoftSimp=0, LoftType=0, Rebuild=10, Refit=0.01})

# ----
# creating the middle of the stand
width_of_stand = Slider(23, range=0..100)
stand_height = Slider(94.7, range=0..100)
cir_3 = Circle(Plane=xy, Radius=width_of_stand)
vec_2 = VectorXYZ(XComponent=0, YComponent=0, ZComponent=base_height)  # -> Vector, Length
cir_4 = Circle(Plane=PlaneXY(0, 0, 0), Radius=width_of_stand)
vec_3 = VectorXYZ(XComponent=0, YComponent=0, ZComponent=stand_height)  # -> Vector, Length
move_3 = Move(Geometry=cir_3, Motion=vec_2.Vector)  # -> Geometry, Transform
move_4 = Move(Geometry=cir_4, Motion=vec_3.Vector)  # -> Geometry, Transform
loft_3 = Loft(
    Curves=[move_3.Geometry, move_4.Geometry],
    Options={Adjust=False, Closed=False, LoftEnds=0, LoftSimp=0, LoftType=0, Rebuild=10, Refit=0.01})

subtraction = Subtraction(A=stand_height, B=bulb_base_length_in_mm)
vec_4 = VectorXYZ(XComponent=0, YComponent=0, ZComponent=subtraction)  # -> Vector, Length

# ----
# Creating notch for wire to feed through at the bottom
number_slider_2 = Slider(-1, range=-1..10)
number_slider_3 = Slider(-52, range=-100..10)
xz = XZPlane(Origin=Point(0, 0, 0))
multiplication = Multiplication(A=base_width_bottom, B=number_slider_2)
cir_5 = Circle(Plane=xz, Radius=Slider(6.8, range=0..10))
vec_5 = VectorXYZ(XComponent=0, YComponent=multiplication, ZComponent=0)  # -> Vector, Length
move_5 = Move(Geometry=cir_5, Motion=vec_5.Vector)  # -> Geometry, Transform
pull = PullCurve(Curve=move_5.Geometry, Surface=loft_2)
srfsplit = SurfaceSplit(Surface=loft_2, Curves=pull)
item = ListItem(List=srfsplit, Index=Slider(0, range=0..100), Wrap=True)

# ----
# connecting the base with the middle
loft_4 = Loft(
    Curves=[move_2.Geometry, move_3.Geometry],
    Options={Adjust=False, Closed=False, LoftEnds=0, LoftSimp=0, LoftType=0, Rebuild=10, Refit=0.01})

# ----
# Creating place for bulb socket to sit (diameter will change when we get the final dimensions of the socket)
bulb_base_diameter_in_mm = Slider(40, range=0..100)
multiplication_2 = Multiplication(A=Slider(0.5, range=0..1), B=bulb_base_diameter_in_mm)
subtraction_2 = Subtraction(A=multiplication_2, B=Slider(3.1, range=0..10))
cir_6 = Circle(Plane=PlaneXY(0, 0, 0), Radius=multiplication_2)
cir_7 = Circle(Plane=PlaneXY(0, 0, 0), Radius=subtraction_2)
move_6 = Move(Geometry=cir_6, Motion=vec_3.Vector)  # -> Geometry, Transform
move_7 = Move(Geometry=cir_7, Motion=vec_4.Vector)  # -> Geometry, Transform
loft_5 = Loft(
    Curves=[move_4.Geometry, move_6.Geometry],
    Options={Adjust=False, Closed=False, LoftEnds=0, LoftSimp=0, LoftType=0, Rebuild=10, Refit=0.01})
loft_6 = Loft(
    Curves=[move_7.Geometry, move_6.Geometry],
    Options={Adjust=False, Closed=False, LoftEnds=0, LoftSimp=0, LoftType=0, Rebuild=10, Refit=0.01})
cir_8 = Circle(Plane=PlaneXY(0, 0, 0), Radius=subtraction_2)

vector_xyz_2 = VectorXYZ(XComponent=0, YComponent=0, ZComponent=height)  # -> Vector, Length
vector_xyz_3 = VectorXYZ(XComponent=0, YComponent=0, ZComponent=0)  # -> Vector, Length
point = Point(vector_xyz_3.Vector)
point_2 = Point(vector_xyz_2.Vector)
line_2 = Line(StartPoint=point_2, EndPoint=point)
twist = Twist(Geometry=loft, Axis=line_2, Angle=Slider(0, range=0..2.5), Infinite=False, Rigid=False)
panel = Panel("twist")
cap_holes = CapHoles(Brep=twist)
merge = Merge(Data1=cap_holes)

# ----
# tube for wire at bottom
number_slider_4 = Slider(0, range=0..1)
addition = Addition(A=base_width_bottom, B=width_of_stand)
multiplication_3 = Multiplication(A=addition, B=number_slider_4)
vec_6 = VectorXYZ(XComponent=0, YComponent=multiplication_3, ZComponent=0)  # -> Vector, Length
move_8 = Move(Geometry=pull, Motion=vec_6.Vector)  # -> Geometry, Transform
loft_7 = Loft(
    Curves=[cir_8, move_7.Geometry],
    Options={Adjust=False, Closed=False, LoftEnds=0, LoftSimp=0, LoftType=0, Rebuild=10, Refit=0.01})
pull_2 = PullCurve(Curve=move_8.Geometry, Surface=loft_7)
srfsplit_2 = SurfaceSplit(Surface=loft_7, Curves=pull_2)
item_2 = ListItem(List=srfsplit_2, Index=Slider(0, range=0..100), Wrap=True)
loft_8 = Loft(Curves=[pull_2, pull], Options={Adjust=False, Closed=False, LoftEnds=0, LoftSimp=0, LoftType=0, Rebuild=10, Refit=0.01})

# ----
# mapping slices to xy plane
number_slider_5 = Slider(215, range=0..300)
construct_domain = ConstructDomain(DomainStart=number_slider_5, DomainEnd=Slider(3019, range=0..4000))
range = Range(Domain=construct_domain, Steps=Slider(10, range=0..20))
unit_x = UnitX(Factor=range)
xy_plane = XYPlane(Origin=Point(0, 0, 0))
move_9 = Move(Geometry=xy_plane, Motion=unit_x)  # -> Geometry, Transform
area_3 = Area(Geometry=move_9.Geometry)  # -> Area, Centroid

join = BrepJoin(Breps=[loft_6, loft_5])  # -> Breps, Closed

panel_2 = Panel("inner shape")
number_slider_6 = Slider(0.7, range=0..1)
scale_nu = ScaleNU(Geometry=twist, Plane=PlaneXY(0, 0, 0), ScaleX=number_slider_6, ScaleY=number_slider_6, ScaleZ=1)  # -> Geometry, Transform
cap_holes_2 = CapHoles(Brep=scale_nu.Geometry)
merge_2 = Merge(Data1=cap_holes_2)

sunion = SolidUnion(Breps=[loft_5, loft_3, join.Breps])
sunion_2 = SolidUnion(Breps=[loft_8, item_2, item, loft_3, loft_4])
join_2 = BrepJoin(Breps=[join.Breps, sunion, sunion_2])  # -> Breps, Closed
join_3 = BrepJoin(Breps=[join.Breps, join_2.Breps])  # -> Breps, Closed

division = Division(A=Slider(360, range=0..1000), B=Slider(18, range=0..50))
series = Series(Start=0, Step=division, Count=10)
multiplication_4 = Multiplication(A=division, B=Slider(-1, range=-1..10))
radians = Radians(Degrees=series)
series_2 = Series(Start=0, Step=multiplication_4, Count=10)
panel_3 = Panel("slicing algorithm/outer contours")
yz_plane = YZPlane(Origin=Point(0, 0, 0))
radians_2 = Radians(Degrees=series_2)
rotate = Rotate(Geometry=yz_plane, Angle=radians, Plane=PlaneXY(0, 0, 0))  # -> Geometry, Transform
brep_plane = BrepPlane(Brep=merge, Plane=rotate.Geometry)  # -> flatten(Curves), Points
orient = Orient(Geometry=brep_plane.Curves, Source=yz_plane, Target=move_9.Geometry)  # -> Geometry, Transform
unit_y = UnitY(Factor=1)
rotate_3d = Rotate3D(Geometry=orient.Geometry, Angle=radians_2, Center=area_3.Centroid, Axis=unit_y)  # -> Geometry, Transform

brep_plane_2 = BrepPlane(Brep=merge_2, Plane=rotate.Geometry)  # -> flatten(Curves), Points
orient_2 = Orient(Geometry=brep_plane_2.Curves, Source=yz_plane, Target=move_9.Geometry)  # -> Geometry, Transform
panel_4 = Panel("inner contours")
rotate_3d_2 = Rotate3D(Geometry=orient_2.Geometry, Angle=radians_2, Center=area_3.Centroid, Axis=unit_y)  # -> Geometry, Transform

explode = Explode(Curve=rotate_3d.Geometry, Recursive=True)  # -> Segments, Vertices
list_length = ListLength(List=rotate_3d.Geometry)
panel_5 = Panel("display text")
number_slider_7 = Slider(7, range=0..50)
list_item = ListItem(List=explode.Segments, Index=0, Wrap=True)  # -> flatten(Item)
series_3 = Series(Start=Slider(1, range=0..1), Step=1, Count=list_length)
list_item_2 = ListItem(List=explode.Segments, Index=Slider(2, range=0..10), Wrap=True)  # -> flatten(Item)
text_tag_3d = TextTag3D(Location=list_item, Text=series_3, Size=number_slider_7, Justification=7)
text_tag_3d_2 = TextTag3D(Location=list_item_2, Text=series_3, Size=number_slider_7, Justification=7)
