# Grasshopper definition lampshade_vertical_slicer.gh (Grasshopper 1.0.8)

amount_of_sides = Slider(5, range=0..10)
top_width = Slider(70, range=0..200)
base_width = Slider(76, range=0..200)
height = Slider(190, range=0..500)
center_width = Slider(86, range=0..200)
shape_spacing = Slider(25, range=0..200)

# ----
# mapping slices to xy plane
number_slider = Slider(3000, range=0..3000)
dom = ConstructDomain(DomainStart=Slider(209, range=0..300), DomainEnd=number_slider)
range = Range(Domain=dom, Steps=Slider(20, range=0..20))
xy = XYPlane(Origin=Point(0, 0, 0))
X = UnitX(Factor=range)
move = Move(Geometry=xy, Motion=X)  # -> Geometry, Transform

# ----
# setting up the base shape
polygon = Polygon(Plane=PlaneXY(0, 0, 0), Radius=base_width, Segments=amount_of_sides, FilletRadius=0)  # -> Polygon, Length
vec = VectorXYZ(XComponent=0, YComponent=0, ZComponent=height)  # -> Vector, Length
polygon_2 = Polygon(Plane=PlaneXY(0, 0, 0), Radius=top_width, Segments=amount_of_sides, FilletRadius=0)  # -> Polygon, Length
polygon_3 = Polygon(Plane=PlaneXY(0, 0, 0), Radius=center_width, Segments=amount_of_sides, FilletRadius=0)  # -> Polygon, Length
vec_2 = VectorXYZ(XComponent=0, YComponent=0, ZComponent=shape_spacing)  # -> Vector, Length
move_2 = Move(Geometry=polygon_2.Polygon, Motion=vec.Vector)  # -> Geometry, Transform
move_3 = Move(Geometry=polygon_3.Polygon, Motion=vec_2.Vector)  # -> Geometry, Transform
loft = Loft(
    Curves=[move_2.Geometry, move_3.Geometry, polygon.Polygon],
    Options={Adjust=False, Closed=False, LoftEnds=0, LoftSimp=0, LoftType=0, Rebuild=10, Refit=0.01})

vec_3 = VectorXYZ(XComponent=0, YComponent=0, ZComponent=height)  # -> Vector, Length
vec_4 = VectorXYZ(XComponent=0, YComponent=0, ZComponent=0)  # -> Vector, Length
pt = Point(vec_4.Vector)
pt_2 = Point(vec_3.Vector)
ln = Line(StartPoint=pt_2, EndPoint=pt)
panel = Panel("twist")
twist = Twist(Geometry=loft, Axis=ln, Angle=Slider(0, range=0..2.5), Infinite=False, Rigid=False)

bbox = BoundingBox(Content=twist, Plane=PlaneXY(0, 0, 0))  # -> Box, Box_2
debox = DeconstructBox(Box=bbox.Box)  # -> Plane, X, Y, Z
dedomain = DeconstructDomain(Domain=debox.Y)  # -> Start, End
yz = YZPlane(Origin=Point(0, 0, 0))
c_duplicate = DuplicateContent(Content=twist)
scale_nu = ScaleNU(Geometry=c_duplicate, Plane=PlaneXY(0, 0, 0), ScaleX=Slider(0.8, range=0..1), ScaleY=Slider(0.8, range=0..1), ScaleZ=1)  # -> Geometry, Transform
# This is super messy, I was fumbling around to get something to work :(
# will be cleaned up once there's a working solution
cap = CapHoles(Brep=scale_nu.Geometry)
debrep = DeconstructBrep(Brep=cap)  # -> Faces, Edges, Vertices
item = ListItem(List=debrep.Faces, Index=Slider(6, range=0..10), Wrap=True)  # -> flatten(Item)
item_2 = ListItem(List=debrep.Faces, Index=Slider(5, range=0..10), Wrap=True)  # -> flatten(Item)
boundary = BoundarySurfaces(Edges=[item, move_2.Geometry])
boundary_2 = BoundarySurfaces(Edges=[item_2, polygon.Polygon])
join = BrepJoin(Breps=[scale_nu.Geometry, boundary_2, boundary])  # -> Breps, Closed
join_2 = BrepJoin(Breps=[twist, boundary, boundary_2])  # -> Breps, Closed

# ----
# creating slices across z axis
amount_of_slices = Slider(14, range=0..20)
dom_2 = ConstructDomain(DomainStart=dedomain.Start, DomainEnd=dedomain.End)
range_2 = Range(Domain=dom_2, Steps=amount_of_slices)

X_2 = UnitX(Factor=range_2)
Y = UnitY(Factor=range_2)

move_4 = Move(Geometry=yz, Motion=X_2)  # -> Geometry, Transform

sec = BrepPlane(Brep=join_2.Breps, Plane=move_4.Geometry)  # -> flatten(Curves), Points
sec_2 = BrepPlane(Brep=join.Breps, Plane=move_4.Geometry)  # -> flatten(Curves), Points
sec_3 = MeshPlane(Mesh=join_2.Breps, Plane=move_4.Geometry)  # -> flatten(Curves)
sec_4 = MeshPlane(Mesh=join.Breps, Plane=move_4.Geometry)  # -> flatten(Curves)
panel_2 = Panel(sec_2.Curves)
orient = Orient(Geometry=sec_3, Source=move_4.Geometry, Target=move.Geometry)  # -> Geometry, Transform
orient_2 = Orient(Geometry=sec_4, Source=move_4.Geometry, Target=move.Geometry)  # -> Geometry, Transform
merge = Merge(Data1=orient_2.Geometry, Data2=orient.Geometry)
projecta = ProjectAlong(Geometry=[orient_2.Geometry, orient.Geometry], Plane=PlaneXY(0, 0, 0), Direction=Vector(0, 0, -1))  # -> Geometry, Transform
